# Grasshopper definition Computational Techniques in Performance-Based Architectural Design A Comprehensive Case Study(Fenestration generation with interference point).gh (Grasshopper 1.0.7)
# plug-ins: LunchBox

open_weather_file = Ladybug_OpenEPWWeatherFile(open=Toggle(True))  # -> epwFile; plug-in component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
open_weather_file_2 = Ladybug_OpenEPWWeatherFile(open=Toggle(True))  # -> epwFile; plug-in component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
ladybug = Ladybug_Ladybug()  # -> out; plug-in component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
gencumulativeskymtx = Ladybug_GenCumulativeSkyMtx(epwFile=open_weather_file, skyDensity=0, useOldRes=True, runIt=Toggle(True))  # -> out, cumulativeSkyMtx; plug-in component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
analysisperiod = Ladybug_AnalysisPeriod(
    fromMonth=Slider(12, range=0..100),
    fromDay=Slider(1, range=0..1),
    fromHour=Slider(0, range=0..100),
    toMonth=Slider(2, range=0..10),
    toDay=Slider(28, range=0..100),
    toHour=Slider(24, range=0..100))  # -> out, analysisPeriod; plug-in component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
gencumulativeskymtx_2 = Ladybug_GenCumulativeSkyMtx(epwFile=open_weather_file_2, skyDensity=0, useOldRes=True, runIt=Toggle(True))  # -> out, cumulativeSkyMtx; plug-in component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
analysisperiod_2 = Ladybug_AnalysisPeriod(
    fromMonth=Slider(6, range=0..10),
    fromDay=Slider(1, range=0..1),
    fromHour=Slider(0, range=0..100),
    toMonth=Slider(8, range=0..10),
    toDay=Slider(31, range=0..100),
    toHour=Slider(24, range=0..100))  # -> out, analysisPeriod; plug-in component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
brep = Brep(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)
brep_2 = Brep([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])

# ---- group: 计算物
brep_3 = Brep(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)

# ---- group: 遮挡物
brep_4 = Brep([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])

# ----
selectskymtx = Ladybug_selectSkyMtx(
    cumulativeSkyMtx=gencumulativeskymtx.cumulativeSkyMtx,
    analysisPeriod=analysisperiod.analysisPeriod,
    removeDiffuse=False,
    removeDirect=False)  # -> out, selectedSkyMtx; plug-in component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
selectskymtx_2 = Ladybug_selectSkyMtx(
    cumulativeSkyMtx=gencumulativeskymtx_2.cumulativeSkyMtx,
    analysisPeriod=analysisperiod_2.analysisPeriod,
    removeDiffuse=False,
    removeDirect=False)  # -> out, selectedSkyMtx; plug-in component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
boolean_toggle = BooleanToggle(True)
boolean_toggle_2 = BooleanToggle(True)
radiationanalysis = Ladybug_RadiationAnalysis(
    geometry=flatten(brep),
    context=flatten(brep_2),
    gridSize=Slider(1, range=0..10),
    disFromBase=Slider(0.5, range=0..1),
    selectedSkyMtx=flatten(selectskymtx.selectedSkyMtx),
    parallel=boolean_toggle,
    runIt=boolean_toggle)  # -> out, contextMesh, analysisMesh, testPts, testVec, port, radiationResult, radiationMesh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; plug-in component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
radiationanalysis_2 = Ladybug_RadiationAnalysis(
    geometry=flatten(brep_3),
    context=flatten(brep_4),
    gridSize=Slider(1, range=0..10),
    disFromBase=Slider(0.5, range=0..1),
    selectedSkyMtx=flatten(selectskymtx_2.selectedSkyMtx),
    parallel=boolean_toggle_2,
    runIt=boolean_toggle_2)  # -> out, contextMesh, analysisMesh, testPts, testVec, port, radiationResult, radiationMesh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; plug-in component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
panel = Panel(radiationanalysis.radiationResult)
panel_2 = Panel(radiationanalysis_2.radiationResult)
point = Point(radiationanalysis.testPts)
panel_3 = Panel(radiationanalysis_2.testPts)
gradient = Gradient(
    LowerLimit=Slider(100, range=0..1000),
    UpperLimit=Slider(0, range=0..1000),
    Parameter=panel,
    stops=[0: RGB(234, 38, 0), 0.25: RGB(234, 126, 0), 0.5: RGB(254, 244, 84), 0.75: RGB(173, 203, 249), 1: RGB(75, 107, 169)])
point_2 = Point(radiationanalysis_2.testPts)
custom_preview = CustomPreview(Geometry=point, Material=gradient)
unit_z = UnitZ(Factor=Slider(4.6, range=0..10))
unit_z_2 = UnitZ(Factor=Slider(4.6, range=0..10))
point_3 = Point(<point referenced from the Rhino model>)
number_slider = Slider(2, range=0..10)  # disabled
number_slider_2 = Slider(1, range=0..10)  # disabled
number_slider_3 = Slider(4, range=0..10)  # disabled
number_slider_4 = Slider(1, range=0..10)
number_slider_5 = Slider(4, range=0..10)
number_slider_6 = Slider(36, range=0..100)  # disabled

# ---- group: 点云
subtraction = Subtraction(A=panel_2, B=panel)
deconstruct_domain = DeconstructDomain(Domain=Domain(-70.976188, 285.21378))  # -> Start, End
number = Number(flatten(subtraction))
point_4 = Point(radiationanalysis_2.testPts)
bounds = Bounds(Numbers=number)
panel_4 = Panel(subtraction)
subtraction_2 = Subtraction(A=deconstruct_domain.End, B=deconstruct_domain.Start)
number_2 = Number(120)
gradient_2 = Gradient(
    LowerLimit=number_2,
    UpperLimit=deconstruct_domain.Start,
    Parameter=subtraction,
    stops=[0: RGB(234, 38, 0), 0.25: RGB(234, 126, 0), 0.494: RGB(254, 244, 84), 0.767: RGB(173, 203, 249), 1: RGB(75, 107, 169)])
panel_5 = Panel(subtraction_2)
custom_preview_2 = CustomPreview(Geometry=point_4, Material=gradient_2)

# ----
number_slider_7 = Slider(1, range=0..10)
number_slider_8 = Slider(4, range=0..10)
gradient_3 = Gradient(
    LowerLimit=Slider(80, range=0..1000),
    UpperLimit=Slider(0, range=0..1000),
    Parameter=panel_2,
    stops=[0: RGB(234, 38, 0), 0.25: RGB(234, 126, 0), 0.5: RGB(254, 244, 84), 0.75: RGB(173, 203, 249), 1: RGB(75, 107, 169)])
point_5 = Point(<point referenced from the Rhino model>)  # disabled
point_6 = Point(<point referenced from the Rhino model>)
number_slider_9 = Slider(1, range=0..10)
number_slider_10 = Slider(4, range=0..10)
yz = YZPlane(Origin=Point(0, 0, 0))
xz = XZPlane(Origin=Point(0, 0, 0))
number_slider_11 = Slider(1, range=0..10)
number_slider_12 = Slider(4, range=0..10)
xz_2 = XZPlane(Origin=point_5)  # disabled
number_slider_13 = Slider(4, range=0..10)
series = Series(Start=0, Step=number_slider_3, Count=number_slider)  # disabled
series_2 = Series(Start=0, Step=number_slider_2, Count=number_slider_6)  # disabled
series_3 = Series(Start=0, Step=number_slider_10, Count=Slider(6, range=0..10))
move = Move(Geometry=yz, Motion=unit_z)  # -> Geometry, Transform
xz_3 = XZPlane(Origin=point_3)
series_4 = Series(Start=0, Step=number_slider_5, Count=Slider(6, range=0..10))
point_7 = Point(Point(12.41, -0.02, 4))
number_slider_14 = Slider(4, range=0..10)
series_5 = Series(Start=0, Step=number_slider_4, Count=Slider(12, range=0..100))
number_slider_15 = Slider(4, range=0..10)
number_slider_16 = Slider(4, range=0..10)
number_slider_17 = Slider(4, range=0..10)
series_6 = Series(Start=0, Step=number_slider_8, Count=Slider(3, range=0..10))
number_slider_18 = Slider(4, range=0..10)
series_7 = Series(Start=0, Step=number_slider_7, Count=Slider(18, range=0..100))
move_2 = Move(Geometry=xz, Motion=unit_z_2)  # -> Geometry, Transform
rectangle = Rectangle(Plane=xz_2, XSize=number_slider_2, YSize=number_slider_3, Radius=0)  # -> Rectangle, Length; disabled
number_slider_19 = Slider(1, range=0..10)
point_8 = Point(<point referenced from the Rhino model>)
point_9 = Point(<point referenced from the Rhino model>)
point_10 = Point(<point referenced from the Rhino model>)
point_11 = Point(<point referenced from the Rhino model>)
point_12 = Point(<point referenced from the Rhino model>)
series_8 = Series(Start=0, Step=number_slider_9, Count=Slider(28, range=0..100))
xz_4 = XZPlane(Origin=point_6)
rectangle_2 = Rectangle(Plane=move_2.Geometry, XSize=number_slider_4, YSize=number_slider_5, Radius=0)  # -> Rectangle, Length
Z = UnitZ(Factor=rectangle.Length)  # disabled
number_slider_20 = Slider(1, range=0..10)
number_slider_21 = Slider(1, range=0..10)
number_slider_22 = Slider(1, range=0..10)
rectangle_3 = Rectangle(Plane=xz_3, XSize=number_slider_7, YSize=number_slider_8, Radius=0)  # -> Rectangle, Length
yz_2 = YZPlane(Origin=point_7)
series_9 = Series(Start=0, Step=number_slider_12, Count=Slider(7, range=0..10))
X = UnitX(Factor=series_2)  # disabled
number_slider_23 = Slider(1, range=0..10)
series_10 = Series(Start=0, Step=number_slider_11, Count=Slider(36, range=0..100))
rectangle_4 = Rectangle(Plane=move.Geometry, XSize=number_slider_9, YSize=number_slider_10, Radius=0)  # -> Rectangle, Length
number_slider_24 = Slider(1, range=0..10)
series_11 = Series(Start=0, Step=number_slider_13, Count=Slider(6, range=0..10))
Z_2 = UnitZ(Factor=series_4)
X_2 = UnitX(Factor=series_5)
yz_3 = YZPlane(Origin=point_8)
Z_3 = UnitZ(Factor=series_6)
yz_4 = YZPlane(Origin=point_9)
Y = UnitY(Factor=series_8)
yz_5 = YZPlane(Origin=point_10)
Z_4 = UnitZ(Factor=series_3)
yz_6 = YZPlane(Origin=point_11)
X_3 = UnitX(Factor=series_7)
yz_7 = YZPlane(Origin=point_12)
addition = Addition(A=Z, B=graft(X))  # disabled
series_12 = Series(Start=0, Step=number_slider_14, Count=Slider(3, range=0..10))
series_13 = Series(Start=0, Step=number_slider_15, Count=Slider(7, range=0..10))
series_14 = Series(Start=0, Step=number_slider_16, Count=Slider(6, range=0..10))
series_15 = Series(Start=0, Step=number_slider_17, Count=Slider(3, range=0..10))
rectangle_5 = Rectangle(Plane=xz_4, XSize=number_slider_11, YSize=number_slider_12, Radius=0)  # -> Rectangle, Length
series_16 = Series(Start=0, Step=number_slider_18, Count=Slider(2, range=0..10))
addition_2 = Addition(A=Z_2, B=graft(X_2))
addition_3 = Addition(A=Z_4, B=graft(Y))
addition_4 = Addition(A=Z_3, B=graft(X_3))
series_17 = Series(Start=0, Step=number_slider_19, Count=Slider(28, range=0..100))
Z_5 = UnitZ(Factor=series_9)
move_3 = Move(Geometry=rectangle.Rectangle, Motion=addition)  # -> Geometry, Transform; disabled
X_4 = UnitX(Factor=series_10)
rectangle_6 = Rectangle(Plane=yz_2, XSize=number_slider_19, YSize=number_slider_13, Radius=0)  # -> Rectangle, Length
series_18 = Series(Start=0, Step=number_slider_20, Count=Slider(16, range=0..100))
move_4 = Move(Geometry=rectangle_2.Rectangle, Motion=addition_2)  # -> Geometry, Transform
series_19 = Series(Start=0, Step=number_slider_21, Count=Slider(42, range=0..100))
series_20 = Series(Start=0, Step=number_slider_22, Count=Slider(28, range=0..100))
series_21 = Series(Start=0, Step=number_slider_23, Count=Slider(16, range=0..100))
move_5 = Move(Geometry=rectangle_4.Rectangle, Motion=addition_3)  # -> Geometry, Transform
series_22 = Series(Start=0, Step=number_slider_24, Count=Slider(16, range=0..100))
move_6 = Move(Geometry=rectangle_3.Rectangle, Motion=addition_4)  # -> Geometry, Transform
custom_preview_3 = CustomPreview(Geometry=point_2, Material=gradient_3)
addition_5 = Addition(A=Z_5, B=graft(X_4))
Y_2 = UnitY(Factor=series_17)
rectangle_7 = Rectangle(Plane=yz_3, XSize=number_slider_20, YSize=number_slider_14, Radius=0)  # -> Rectangle, Length
Z_6 = UnitZ(Factor=series_11)
rectangle_8 = Rectangle(Plane=yz_4, XSize=number_slider_21, YSize=number_slider_15, Radius=0)  # -> Rectangle, Length
rectangle_9 = Rectangle(Plane=yz_5, XSize=number_slider_22, YSize=number_slider_16, Radius=0)  # -> Rectangle, Length
rectangle_10 = Rectangle(Plane=yz_6, XSize=number_slider_23, YSize=number_slider_17, Radius=0)  # -> Rectangle, Length
rectangle_11 = Rectangle(Plane=yz_7, XSize=number_slider_24, YSize=number_slider_18, Radius=0)  # -> Rectangle, Length
Y_3 = UnitY(Factor=series_18)
Z_7 = UnitZ(Factor=series_12)
Y_4 = UnitY(Factor=series_19)
Z_8 = UnitZ(Factor=series_13)
Y_5 = UnitY(Factor=series_20)
Z_9 = UnitZ(Factor=series_14)
Y_6 = UnitY(Factor=series_21)
Z_10 = UnitZ(Factor=series_15)
Y_7 = UnitY(Factor=series_22)
addition_6 = Addition(A=Z_6, B=graft(Y_2))
Z_11 = UnitZ(Factor=series_16)
move_7 = Move(Geometry=rectangle_5.Rectangle, Motion=addition_5)  # -> Geometry, Transform
addition_7 = Addition(A=Z_7, B=graft(Y_3))
addition_8 = Addition(A=Z_8, B=graft(Y_4))
addition_9 = Addition(A=Z_9, B=graft(Y_5))
crv = Curve(flatten(move_5.Geometry))
addition_10 = Addition(A=Z_10, B=graft(Y_6))
addition_11 = Addition(A=Z_11, B=graft(Y_7))
move_8 = Move(Geometry=rectangle_6.Rectangle, Motion=addition_6)  # -> Geometry, Transform
move_9 = Move(Geometry=rectangle_7.Rectangle, Motion=addition_7)  # -> Geometry, Transform
move_10 = Move(Geometry=rectangle_8.Rectangle, Motion=addition_8)  # -> Geometry, Transform
move_11 = Move(Geometry=rectangle_9.Rectangle, Motion=addition_9)  # -> Geometry, Transform
move_12 = Move(Geometry=rectangle_10.Rectangle, Motion=addition_10)  # -> Geometry, Transform
move_13 = Move(Geometry=rectangle_11.Rectangle, Motion=addition_11)  # -> Geometry, Transform
pt = Point(flatten(point_4))
crv_2 = Curve(flatten(move_3.Geometry))  # disabled
crv_3 = Curve(flatten(move_4.Geometry))
area = Area(Geometry=crv)  # -> Area, Centroid
crv_4 = Curve(flatten(move_8.Geometry))
crv_5 = Curve(flatten(move_6.Geometry))
num = Number(flatten(subtraction))
pt_2 = Point(flatten(point_4))  # disabled
crv_6 = Curve(flatten(move_9.Geometry))
cp = ClosestPoint(Point=area.Centroid, Cloud=pt)  # -> ClosestPoint, CPIndex, Distance
crv_7 = Curve(flatten(move_10.Geometry))
crv_8 = Curve(flatten(move_11.Geometry))
crv_9 = Curve(flatten(move_12.Geometry))
crv_10 = Curve(flatten(move_13.Geometry))
pt_3 = Point(flatten(point_4))
crv_11 = Curve(flatten(move_7.Geometry))
pt_4 = Point(flatten(point_4))
pt_5 = Point(flatten(point_4))
area_2 = Area(Geometry=crv_2)  # -> Area, Centroid; disabled
lng = ListLength(List=crv)
num_2 = Number(flatten(subtraction))  # disabled
area_3 = Area(Geometry=crv_3)  # -> Area, Centroid
pt_6 = Point(flatten(point_4))
pt_7 = Point(flatten(point_4))
pt_8 = Point(flatten(point_4))
pt_9 = Point(flatten(point_4))
item = ListItem(List=num, Index=cp.CPIndex, Wrap=True)
area_4 = Area(Geometry=crv_5)  # -> Area, Centroid
area_5 = Area(Geometry=crv_4)  # -> Area, Centroid
cp_2 = ClosestPoint(Point=area_2.Centroid, Cloud=pt_2)  # -> ClosestPoint, CPIndex, Distance; disabled
pt_10 = Point(flatten(point_4))
num_3 = Number(flatten(subtraction))
num_4 = Number(flatten(subtraction))
pt_11 = Point(flatten(point_4))
num_5 = Number(flatten(subtraction))
cp_3 = ClosestPoint(Point=area_3.Centroid, Cloud=pt_3)  # -> ClosestPoint, CPIndex, Distance
area_6 = Area(Geometry=crv_6)  # -> Area, Centroid
area_7 = Area(Geometry=crv_7)  # -> Area, Centroid
area_8 = Area(Geometry=crv_8)  # -> Area, Centroid
cp_4 = ClosestPoint(Point=area_4.Centroid, Cloud=pt_5)  # -> ClosestPoint, CPIndex, Distance
cp_5 = ClosestPoint(Point=area_5.Centroid, Cloud=pt_4)  # -> ClosestPoint, CPIndex, Distance
area_9 = Area(Geometry=crv_9)  # -> Area, Centroid
area_10 = Area(Geometry=crv_10)  # -> Area, Centroid
lng_2 = ListLength(List=crv_2)  # disabled
num_6 = Number(flatten(subtraction))
expression = Expression(x=item, Expression="(1-((x+71)/200)*0.8)")
num_7 = Number(flatten(subtraction))
num_8 = Number(flatten(subtraction))
num_9 = Number(flatten(subtraction))
area_11 = Area(Geometry=crv_11)  # -> Area, Centroid
num_10 = Number(flatten(subtraction))
item_2 = ListItem(List=num_2, Index=cp_2.CPIndex, Wrap=True)  # disabled
cp_6 = ClosestPoint(Point=area_6.Centroid, Cloud=pt_6)  # -> ClosestPoint, CPIndex, Distance
number_slider_25 = Slider(16, range=0..100)  # disabled
lng_3 = ListLength(List=crv_3)
cp_7 = ClosestPoint(Point=area_7.Centroid, Cloud=pt_7)  # -> ClosestPoint, CPIndex, Distance
num_11 = Number(flatten(subtraction))
cp_8 = ClosestPoint(Point=area_8.Centroid, Cloud=pt_8)  # -> ClosestPoint, CPIndex, Distance
cp_9 = ClosestPoint(Point=area_9.Centroid, Cloud=pt_9)  # -> ClosestPoint, CPIndex, Distance
cp_10 = ClosestPoint(Point=area_10.Centroid, Cloud=pt_10)  # -> ClosestPoint, CPIndex, Distance
lng_4 = ListLength(List=crv_5)
lng_5 = ListLength(List=crv_4)
item_3 = ListItem(List=num_3, Index=cp_3.CPIndex, Wrap=True)
cp_11 = ClosestPoint(Point=area_11.Centroid, Cloud=pt_11)  # -> ClosestPoint, CPIndex, Distance
item_4 = ListItem(List=num_5, Index=cp_4.CPIndex, Wrap=True)
item_5 = ListItem(List=num_4, Index=cp_5.CPIndex, Wrap=True)
lng_6 = ListLength(List=crv_6)
random = Random(Range=Domain(0, 1), Number=lng, Seed=Slider(44, range=0..100))
lng_7 = ListLength(List=crv_7)
lng_8 = ListLength(List=crv_8)
lng_9 = ListLength(List=crv_9)
lng_10 = ListLength(List=crv_10)
expression_2 = Expression(x=item_2, Expression="(1-((x+71)/180)*0.2)")  # disabled
item_6 = ListItem(List=num_6, Index=cp_6.CPIndex, Wrap=True)
item_7 = ListItem(List=num_7, Index=cp_7.CPIndex, Wrap=True)
item_8 = ListItem(List=num_8, Index=cp_8.CPIndex, Wrap=True)
lng_11 = ListLength(List=crv_11)
item_9 = ListItem(List=num_9, Index=cp_9.CPIndex, Wrap=True)
item_10 = ListItem(List=num_10, Index=cp_10.CPIndex, Wrap=True)
expression_3 = Expression(x=item_3, Expression="(1-((x+71)/180)*3)")
expression_4 = Expression(x=item_5, Expression="(1-((x+71)/200)*0.9)")
item_11 = ListItem(List=num_11, Index=cp_11.CPIndex, Wrap=True)
expression_5 = Expression(x=item_4, Expression="(1-((x+71)/180)*1.1)")
bounds_2 = Bounds(Numbers=expression)
random_2 = Random(Range=Domain(0, 1), Number=lng_2, Seed=number_slider_25)  # disabled
expression_6 = Expression(x=item_6, Expression="(1-((x+71)/200)*0.6)")
expression_7 = Expression(x=item_7, Expression="(1-((x+71)/200)*0.6)")
expression_8 = Expression(x=item_8, Expression="(1-((x+71)/200)*0.85)")
expression_9 = Expression(x=item_9, Expression="(1-((x+71)/200)*0.6)")
expression_10 = Expression(x=item_10, Expression="(1-((x+71)/200)*0.6)")
larger = LargerThan(FirstNumber=expression, SecondNumber=random)  # -> LargerThan, OrEqualTo
random_3 = Random(Range=Domain(0, 1), Number=lng_3, Seed=Slider(23, range=0..100))
random_4 = Random(Range=Domain(0, 1), Number=lng_4, Seed=Slider(36, range=0..100))
random_5 = Random(Range=Domain(0, 1), Number=lng_5, Seed=Slider(64, range=0..100))
expression_11 = Expression(x=item_11, Expression="(1-((x+71)/180)*1.1)")
bounds_3 = Bounds(Numbers=expression_2)  # disabled
panel_6 = Panel(random)
random_6 = Random(Range=Domain(0, 1), Number=lng_6, Seed=Slider(63, range=0..100))
random_7 = Random(Range=Domain(0, 1), Number=lng_7, Seed=Slider(56, range=0..100))
random_8 = Random(Range=Domain(0, 1), Number=lng_8, Seed=Slider(7, range=0..100))
random_9 = Random(Range=Domain(0, 1), Number=lng_9, Seed=Slider(56, range=0..100))
random_10 = Random(Range=Domain(0, 1), Number=lng_10, Seed=Slider(56, range=0..100))
bounds_4 = Bounds(Numbers=expression_3)
larger_2 = LargerThan(FirstNumber=expression_2, SecondNumber=random_2)  # -> LargerThan, OrEqualTo; disabled
random_11 = Random(Range=Domain(0, 1), Number=lng_11, Seed=Slider(36, range=0..100))
bounds_5 = Bounds(Numbers=expression_5)
panel_7 = Panel(random_2)  # disabled
larger_3 = LargerThan(FirstNumber=expression_3, SecondNumber=random_3)  # -> LargerThan, OrEqualTo
larger_4 = LargerThan(FirstNumber=expression_5, SecondNumber=random_4)  # -> LargerThan, OrEqualTo
larger_5 = LargerThan(FirstNumber=expression_4, SecondNumber=random_5)  # -> LargerThan, OrEqualTo
panel_8 = Panel(random_3)
dispatch = Dispatch(List=crv, DispatchPattern=larger.LargerThan)  # -> ListA, ListB
panel_9 = Panel(random_4)
bounds_6 = Bounds(Numbers=expression_4)
bounds_7 = Bounds(Numbers=expression_11)
larger_6 = LargerThan(FirstNumber=expression_6, SecondNumber=random_6)  # -> LargerThan, OrEqualTo
larger_7 = LargerThan(FirstNumber=expression_7, SecondNumber=random_7)  # -> LargerThan, OrEqualTo
larger_8 = LargerThan(FirstNumber=expression_8, SecondNumber=random_8)  # -> LargerThan, OrEqualTo
larger_9 = LargerThan(FirstNumber=expression_9, SecondNumber=random_9)  # -> LargerThan, OrEqualTo
panel_10 = Panel(random_5)
larger_10 = LargerThan(FirstNumber=expression_10, SecondNumber=random_10)  # -> LargerThan, OrEqualTo
bounds_8 = Bounds(Numbers=expression_6)
bounds_9 = Bounds(Numbers=expression_7)
bounds_10 = Bounds(Numbers=expression_8)
larger_11 = LargerThan(FirstNumber=expression_11, SecondNumber=random_11)  # -> LargerThan, OrEqualTo
bounds_11 = Bounds(Numbers=expression_9)
bounds_12 = Bounds(Numbers=expression_10)
panel_11 = Panel(random_6)
panel_12 = Panel(random_7)
panel_13 = Panel(random_11)
panel_14 = Panel(random_8)
panel_15 = Panel(random_9)
dispatch_2 = Dispatch(List=crv_2, DispatchPattern=larger_2.LargerThan)  # -> ListA, ListB; disabled
panel_16 = Panel(random_10)
crv_12 = Curve(dispatch.ListA)
dispatch_3 = Dispatch(List=crv_3, DispatchPattern=larger_3.LargerThan)  # -> ListA, ListB
dispatch_4 = Dispatch(List=crv_5, DispatchPattern=larger_4.LargerThan)  # -> ListA, ListB
dispatch_5 = Dispatch(List=crv_4, DispatchPattern=larger_5.LargerThan)  # -> ListA, ListB
dispatch_6 = Dispatch(List=crv_6, DispatchPattern=larger_6.LargerThan)  # -> ListA, ListB
dispatch_7 = Dispatch(List=crv_7, DispatchPattern=larger_7.LargerThan)  # -> ListA, ListB
dispatch_8 = Dispatch(List=crv_8, DispatchPattern=larger_8.LargerThan)  # -> ListA, ListB
dispatch_9 = Dispatch(List=crv_9, DispatchPattern=larger_9.LargerThan)  # -> ListA, ListB
dispatch_10 = Dispatch(List=crv_10, DispatchPattern=larger_10.LargerThan)  # -> ListA, ListB
dispatch_11 = Dispatch(List=crv_11, DispatchPattern=larger_11.LargerThan)  # -> ListA, ListB
crv_13 = Curve(dispatch_2.ListA)  # disabled
boundary_surfaces = BoundarySurfaces(Edges=crv_12)
crv_14 = Curve(dispatch_3.ListA)
crv_15 = Curve(dispatch_5.ListA)
crv_16 = Curve(dispatch_4.ListA)
crv_17 = Curve(dispatch_6.ListA)
crv_18 = Curve(dispatch_7.ListA)
crv_19 = Curve(dispatch_8.ListA)
boundary_surfaces_2 = BoundarySurfaces(Edges=crv_13)  # disabled
crv_20 = Curve(dispatch_9.ListA)
crv_21 = Curve(dispatch_10.ListA)
crv_22 = Curve(dispatch_11.ListA)
boundary_surfaces_3 = BoundarySurfaces(Edges=crv_14)
boundary_surfaces_4 = BoundarySurfaces(Edges=crv_16)
boundary_surfaces_5 = BoundarySurfaces(Edges=crv_15)
boundary_surfaces_6 = BoundarySurfaces(Edges=crv_17)
boundary_surfaces_7 = BoundarySurfaces(Edges=crv_18)
boundary_surfaces_8 = BoundarySurfaces(Edges=crv_19)
boundary_surfaces_9 = BoundarySurfaces(Edges=crv_20)
boundary_surfaces_10 = BoundarySurfaces(Edges=crv_21)
boundary_surfaces_11 = BoundarySurfaces(Edges=crv_22)

# ---- group: split
surface = Surface(<surface referenced from the Rhino model>)
quad_panels = QuadPanels(Surface=surface, UDivisions=Slider(8, range=0..10), VDivisions=Slider(8, range=0..10))
surface_2 = Surface(quad_panels)
quad_panels_2 = QuadPanels(Surface=quad_panels, UDivisions=Slider(5, range=0..10), VDivisions=Slider(1, range=0..1))
surface_3 = Surface(quad_panels_2)
list_length = ListLength(List=quad_panels_2)
random_split_list = RandomSplitList(MasterList=surface_3, Seed=Slider(1, range=0..10), Split=0.5)  # -> ListA, ListB
panel_17 = Panel(list_length)
surface_4 = Surface(random_split_list.ListA)
surface_5 = Surface(random_split_list.ListB)
surface_6 = Surface(<surface referenced from the Rhino model>)
divide_domain² = DivideDomain²(Domain=surface_6, UCount=Slider(17, range=0..20), VCount=Slider(8, range=0..20))
isotrim = Isotrim(Surface=surface_6, Domain=divide_domain²)
flatten_tree = FlattenTree(Tree=isotrim, Path="{0}")
flatten_tree_2 = FlattenTree(Tree=flatten_tree, Path="{0}")
random_reduce = RandomReduce(List=flatten_tree_2, Reduction=Slider(29, range=0..100), Seed=1)
item_index = ItemIndex(List=flatten_tree_2, Item=random_reduce)
flatten_tree_3 = FlattenTree(Tree=random_reduce, Path="{0}")
graft_tree = GraftTree(Tree=flatten_tree_3, IncludeEmptyLists=True, IncludeNullItems=True)

# ---- group: daylight
open_weather_file_3 = Ladybug_OpenEPWWeatherFile(open=Toggle(True))  # -> epwFile; plug-in component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
importepw = Ladybug_ImportEpw(epwFile=open_weather_file_3)  # -> Output, latitude, location, dryBulbTemperature, dewPointTemperature, relativeHumidity, windSpeed, windDirection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; plug-in component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
vector = Vector(Vector(0, 1075, 0))
series_23 = Series(Start=Slider(1, range=0..100), Step=Slider(1, range=0..100), Count=Slider(24, range=0..100))
sunpath = Ladybug_SunPath(
    north=vector,
    location=importepw.location,
    hour=series_23,
    day=Slider(20, range=0..100),
    month=Slider(1, range=0..1),
    timeStep=1,
    sunPathScale=Slider(1, range=0..1),
    sunScale=Slider(3, range=0..10),
    dailyOrAnnualSunPath=True)  # -> out, sunVectors, sunAltitudes, sunAzimuths, port, sunSpheresMesh, sunPathCrvs, compassCrvs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; plug-in component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
number_slider_26 = Slider(0.1, range=0..1)
brep_5 = Brep([<brep referenced from the Rhino model> x15])
brep_6 = Brep(<brep referenced from the Rhino model>)
sunlighthoursanalysis = Ladybug_SunlightHoursAnalysis(
    geometry=flatten(brep_6),
    context=flatten(brep_5),
    gridSize=number_slider_26,
    disFromBase=number_slider_26,
    sunVectors=flatten(sunpath.sunVectors),
    timeStep=1,
    runIt=Toggle(True))  # -> out, contextMesh, analysisMesh, testPts, testVec, port, sunlightHoursResult, sunlightHoursMesh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; plug-in component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
geometry = Geometry(sunlighthoursanalysis.sunlightHoursLegend)
mesh = Mesh(sunlighthoursanalysis.sunlightHoursMesh)
