# Grasshopper definition Computational Techniques in Performance-Based Architectural Design A Comprehensive Case Study.gh (Grasshopper 1.0.7)
# plug-ins: DIVA Daylight, EvolveComponent

additiveformmassingcomponent = AdditiveFormMassingComponent(
    AdditiveComponentData_EnableAttractPoing=False,
    AdditiveComponentData_EnableBottomCutter=False,
    AdditiveComponentData_EnableCore=False,
    AdditiveComponentData_EnableFixedCutter=False,
    AdditiveComponentData_EnableMiddleCutter=False,
    AdditiveComponentData_EncloreFactor=0.25,
    AdditiveComponentData_ExFacadeType=0,
    AdditiveComponentData_FloatingCheck=True,
    AdditiveComponentData_FloorHeight=3.8,
    AdditiveComponentData_FloorNumberZ=8,
    AdditiveComponentData_HorizontalCuttingSolidNum=4,
    AdditiveComponentData_HorizontalCuttingSolidSizeLow=2,
    AdditiveComponentData_HorizontalCuttingSolidSizeUp=4,
    AdditiveComponentData_InFacadeType=0,
    AdditiveComponentData_IsSet=True,
    AdditiveComponentData_NumberofParameters=6,
    AdditiveComponentData_OverhangCheck=True,
    AdditiveComponentData_PlaneSet=False,
    AdditiveComponentData_SetTargetArea=True,
    AdditiveComponentData_SingleFloorCheck=True,
    AdditiveComponentData_SpanNumberX=9,
    AdditiveComponentData_SpanNumberY=7,
    AdditiveComponentData_SpanSize=6,
    AdditiveComponentData_TargetGrossArea=11000,
    AdditiveComponentData_V0=2,
    AdditiveComponentData_V1=4,
    AdditiveComponentData_V2=7,
    AdditiveComponentData_VerticalCuttingSolidNum=3,
    AdditiveComponentData_VerticalCuttingSolidSizeLow=2,
    AdditiveComponentData_VerticalCuttingSolidSizeUp=4,
    AdditiveComponentData_LowerBoundofParameters=[0, 0, 0, 0, 0, 0],
    AdditiveComponentData_NumberofVariables=[7, 7, 7, 7, 7, 7],
    AdditiveComponentData_TypeofParameters=[0, 0, 0, 0, 0, 0],
    AdditiveComponentData_UpperBoundofParameters=[1, 1, 1, 1, 1, 1],
    AdditiveComponentData_X0=[0.7476141452, 0.1364547047, 0.2734707693, 0.2351961216, 0.1291390728, 0.8317505535, 0.348207913],
    AdditiveComponentData_X1=[0.6523178808, 0.9503311258, 0.2284768212, 0.2005517195, 0.04304635762, 0.5463576159, 0.5397350993],
    AdditiveComponentData_Y0=[0.321192053, 0.7251655629, 0.6423960089, 0.7450331126, 0.4393136676, 0.9567921306, 0.172799619],
    AdditiveComponentData_Y1=[0.108629609, 0.5916644221, 0.1015298721, 0.155253355, 0.738410596, 0.9353011455, 0.842579551],
    AdditiveComponentData_Z0=[0.1898127306, 0.05494906663, 0.6721854305, 0.9900662252, 0.9134386228, 0.9033788577, 0.2797350475],
    AdditiveComponentData_Z1=[0.7464359956, 0.1924014539, 0.8907284768, 0.4529456801, 0.8862618994, 0.72396185, 0.8806965169])  # -> GrossArea, FloorPlanBoundary, FloorPlanSurface, RoofSurface, CoreSurface, ExteriorSolidFacade, ExteriorGlazingFacade, ExteriorFacade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
brep = Brep([<brep referenced from the Rhino model> x14])
surface = Surface(<surface referenced from the Rhino model>)
scene_object = SceneObject(
    Geometry=brep,
    BooleanValue_0=False,
    BooleanValue_1=False,
    Color_0=RGBA(0, 0, 0, 0),
    Color_1=RGBA(0, 0, 0, 0),
    Hidden_0=False,
    Hidden_1=False,
    IntegerValue_0=-2147483648,
    IntegerValue_1=-2147483648,
    IntervalMax_0=-1.797693135e+308,
    IntervalMax_1=-1.797693135e+308,
    IntervalMin_0=-1.797693135e+308,
    IntervalMin_1=-1.797693135e+308,
    Name_0="Geometry",
    Name_1="Material",
    NumberValue_0=-1.797693135e+308,
    NumberValue_1=-1.797693135e+308,
    OutputHidden_0=False,
    OutputName_0="Scene Object",
    TextValuePersistent_1="OutsideFacade_30",
    TextValueVolatile_1="OutsideFacade_30")
daylighting_grid = DaylightingGrid(
    Geometry=surface,
    Spacing=2.5,
    BooleanValue_0=False,
    BooleanValue_1=False,
    BooleanValue_10=False,
    BooleanValue_11=False,
    BooleanValue_12=False,
    BooleanValue_13=False,
    BooleanValue_14=False,
    BooleanValue_15=False,
    BooleanValue_16=False,
    BooleanValue_17=False,
    BooleanValue_18=False,
    BooleanValue_19=False,
    BooleanValue_2=False,
    BooleanValue_20=False,
    BooleanValue_21=False,
    BooleanValue_22=False,
    BooleanValue_3=False,
    BooleanValue_4=False,
    BooleanValue_5=False,
    BooleanValue_6=False,
    BooleanValue_7=False,
    BooleanValue_8=False,
    BooleanValue_9=False,
    Color_0=RGBA(0, 0, 0, 0),
    Color_1=RGBA(0, 0, 0, 0),
    Color_10=RGBA(0, 0, 0, 0),
    Color_11=RGBA(0, 0, 0, 0),
    Color_12=RGBA(0, 0, 0, 0),
    Color_13=RGBA(0, 0, 0, 0),
    Color_14=RGBA(0, 0, 0, 0)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)
brep_2 = Brep(flatten(additiveformmassingcomponent.RoofSurface))
brep_3 = Brep([<brep referenced from the Rhino model> x15])
list_length = ListLength(List=brep_2)
scene_object_2 = SceneObject(
    Geometry=brep_3,
    BooleanValue_0=False,
    BooleanValue_1=False,
    Color_0=RGBA(0, 0, 0, 0),
    Color_1=RGBA(0, 0, 0, 0),
    Hidden_0=False,
    Hidden_1=False,
    IntegerValue_0=-2147483648,
    IntegerValue_1=-2147483648,
    IntervalMax_0=-1.797693135e+308,
    IntervalMax_1=-1.797693135e+308,
    IntervalMin_0=-1.797693135e+308,
    IntervalMin_1=-1.797693135e+308,
    Name_0="Geometry",
    Name_1="Material",
    NumberValue_0=-1.797693135e+308,
    NumberValue_1=-1.797693135e+308,
    OutputHidden_0=False,
    OutputName_0="Scene Object",
    TextValuePersistent_1="Glazing_TriplePane_Krypton_47",
    TextValueVolatile_1="Glazing_TriplePane_Krypton_47")
boolean_toggle = BooleanToggle(True)
expression = Expression(Variable_x=list_length, Expression="1+(x-1)*0.1")
annual_daylight = AnnualDaylight(
    Name="Temp",
    Grids=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,
    RhinoScene=False,
    Run=False,
    BooleanValue_0=False,
    BooleanValue_1=False,
    BooleanValue_10=False,
    BooleanValue_11=False,
    BooleanValue_12=False,
    BooleanValue_13=False,
    BooleanValue_14=False,
    BooleanValue_15=False,
    BooleanValue_16=False,
    BooleanValue_17=False,
    BooleanValue_2=False,
    BooleanValue_3=False,
    BooleanValue_4=False,
    BooleanValue_5=False,
    BooleanValue_6=False,
    BooleanValue_7=False,
    BooleanValue_8=False,
    BooleanValue_9=False,
    Color_0=RGBA(0, 0, 0, 0),
    Color_1=RGBA(0, 0, 0, 0),
    Color_10=RGBA(0, 0, 0, 0),
    Color_11=RGBA(0, 0, 0, 0),
    Color_12=RGBA(0, 0, 0, 0),
    Color_13=RGBA(0, 0, 0, 0),
    Color_14=RGBA(0, 0, 0, 0),
    Color_15=RGBA(0, 0, 0, 0),
    Color_16=RGBA(0, 0, 0, 0),
    Color_17=RGBA(0, 0, 0, 0),
    Color_2=RGBA(0, 0, 0, 0),
    Color_3=RGBA(0, 0, 0, 0)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)  # -> Out, SDA, ASE, LEEDv4, LightingEnergy, OpenPercentage, Windows, Grids, Zones
list_item = ListItem(List=additiveformmassingcomponent.FloorPlanSurface, Index=0, Wrap=True)
list_item_2 = ListItem(List=additiveformmassingcomponent.GrossArea, Index=0, Wrap=True)
daylighting_grid_2 = DaylightingGrid(
    Geometry=list_item,
    Spacing=2.5,
    BooleanValue_0=False,
    BooleanValue_1=False,
    BooleanValue_10=False,
    BooleanValue_11=False,
    BooleanValue_12=False,
    BooleanValue_13=False,
    BooleanValue_14=False,
    BooleanValue_15=False,
    BooleanValue_16=False,
    BooleanValue_17=False,
    BooleanValue_18=False,
    BooleanValue_19=False,
    BooleanValue_2=False,
    BooleanValue_20=False,
    BooleanValue_21=False,
    BooleanValue_22=False,
    BooleanValue_3=False,
    BooleanValue_4=False,
    BooleanValue_5=False,
    BooleanValue_6=False,
    BooleanValue_7=False,
    BooleanValue_8=False,
    BooleanValue_9=False,
    Color_0=RGBA(0, 0, 0, 0),
    Color_1=RGBA(0, 0, 0, 0),
    Color_10=RGBA(0, 0, 0, 0),
    Color_11=RGBA(0, 0, 0, 0),
    Color_12=RGBA(0, 0, 0, 0),
    Color_13=RGBA(0, 0, 0, 0),
    Color_14=RGBA(0, 0, 0, 0)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)
evolvecomponent = EvolveComponent(
    EvolveData_enable_KMeans_clustering=True,
    EvolveData_enable_optimal_LHS=True,
    EvolveData_gene=additiveformmassingcomponent,
    EvolveData_migrat_rate=0.05,
    EvolveData_mutation_radius_decay_index=1,
    EvolveData_mutation_rate1=0.35,
    EvolveData_mutation_rate2=0.1,
    EvolveData_num_islands=5,
    EvolveData_num_iter=100,
    EvolveData_selection_rate=0.5,
    EvolveData_size_sub_pop=30,
    EvolveData_tour_size=10,
    EvolveData_fitness=expression_6,
    EvolveData_is_max=True)
brep_4 = Brep(flatten(additiveformmassingcomponent.FloorPlanSurface))
expression_2 = Expression(Variable_x=list_item_2, Expression="1-Abs((x-11000)/11000)")
brep_5 = Brep(flatten([additiveformmassingcomponent.ExteriorSolidFacade, additiveformmassingcomponent.InteriorSolidFacade]))
brep_6 = Brep(flatten(additiveformmassingcomponent.RoofSurface))
brep_7 = Brep(flatten([additiveformmassingcomponent.InteriorGlazingFacade, additiveformmassingcomponent.ExteriorGlazingFacade]))
scene_object_3 = SceneObject(
    Geometry=brep_4,
    BooleanValue_0=False,
    BooleanValue_1=False,
    Color_0=RGBA(0, 0, 0, 0),
    Color_1=RGBA(0, 0, 0, 0),
    Hidden_0=False,
    Hidden_1=False,
    IntegerValue_0=-2147483648,
    IntegerValue_1=-2147483648,
    IntervalMax_0=-1.797693135e+308,
    IntervalMax_1=-1.797693135e+308,
    IntervalMin_0=-1.797693135e+308,
    IntervalMin_1=-1.797693135e+308,
    Name_0="Geometry",
    Name_1="Material",
    NumberValue_0=-1.797693135e+308,
    NumberValue_1=-1.797693135e+308,
    OutputHidden_0=False,
    OutputName_0="Scene Object",
    TextValuePersistent_1="GenericFloor_20",
    TextValueVolatile_1="GenericFloor_20")
unit_z = UnitZ(Factor=0.9)
move = Move(Geometry=brep_4, Motion=unit_z)  # -> Geometry, Transform
panel = Panel("""area
density
far
roof
area_punishment
density_punishment
coverage
entrance_punishment
Sda_average
SE_average
fitness""")
graph_mapper = GraphMapper(expression_2, x0=0, x1=1, y0=0, y1=1, Cx=0.7363634706, Cy=0.3624061346, container_name="Conic")
scene_object_4 = SceneObject(
    Geometry=brep_5,
    BooleanValue_0=False,
    BooleanValue_1=False,
    Color_0=RGBA(0, 0, 0, 0),
    Color_1=RGBA(0, 0, 0, 0),
    Hidden_0=False,
    Hidden_1=False,
    IntegerValue_0=-2147483648,
    IntegerValue_1=-2147483648,
    IntervalMax_0=-1.797693135e+308,
    IntervalMax_1=-1.797693135e+308,
    IntervalMin_0=-1.797693135e+308,
    IntervalMin_1=-1.797693135e+308,
    Name_0="Geometry",
    Name_1="Material",
    NumberValue_0=-1.797693135e+308,
    NumberValue_1=-1.797693135e+308,
    OutputHidden_0=False,
    OutputName_0="Scene Object",
    TextValuePersistent_1="OutsideFacade_30",
    TextValueVolatile_1="OutsideFacade_30")
scene_object_5 = SceneObject(
    Geometry=brep_7,
    BooleanValue_0=False,
    BooleanValue_1=False,
    Color_0=RGBA(0, 0, 0, 0),
    Color_1=RGBA(0, 0, 0, 0),
    Hidden_0=False,
    Hidden_1=False,
    IntegerValue_0=-2147483648,
    IntegerValue_1=-2147483648,
    IntervalMax_0=-1.797693135e+308,
    IntervalMax_1=-1.797693135e+308,
    IntervalMin_0=-1.797693135e+308,
    IntervalMin_1=-1.797693135e+308,
    Name_0="Geometry",
    Name_1="Material",
    NumberValue_0=-1.797693135e+308,
    NumberValue_1=-1.797693135e+308,
    OutputHidden_0=False,
    OutputName_0="Scene Object",
    TextValuePersistent_1="Glazing_DoublePane_LowE_65",
    TextValueVolatile_1="Glazing_DoublePane_LowE_65")
radiation_map = RadiationMap(
    Name="Temp",
    Grids=daylighting_grid,
    Objects=[scene_object, scene_object_4, scene_object_5, scene_object_2],
    RhinoScene=False,
    Run=boolean_toggle,
    BooleanValue_0=False,
    BooleanValue_1=False,
    BooleanValue_10=False,
    BooleanValue_11=False,
    BooleanValue_12=False,
    BooleanValue_13=False,
    BooleanValue_14=False,
    BooleanValue_15=False,
    BooleanValue_16=False,
    BooleanValue_17=False,
    BooleanValue_18=True,
    BooleanValue_19=False,
    BooleanValue_2=False,
    BooleanValue_3=False,
    BooleanValue_4=False,
    BooleanValue_5=False,
    BooleanValue_6=False,
    BooleanValue_7=False,
    BooleanValue_8=False,
    BooleanValue_9=False,
    Color_0=RGBA(0, 0, 0, 0),
    Color_1=RGBA(0, 0, 0, 0),
    Color_10=RGBA(0, 0, 0, 0),
    Color_11=RGBA(0, 0, 0, 0),
    Color_12=RGBA(0, 0, 0, 0),
    Color_13=RGBA(0, 0, 0, 0),
    Color_14=RGBA(0, 0, 0, 0),
    Color_15=RGBA(0, 0, 0, 0),
    Color_16=RGBA(0, 0, 0, 0),
    Color_17=RGBA(0, 0, 0, 0)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)  # -> Out, SolarEnergy, EnergyDensity, Grid
grid_viewer = GridViewer(
    Grid=radiation_map.Grid,
    Month=1,
    Day=1,
    Hour=12,
    BooleanValue_0=False,
    BooleanValue_1=False,
    BooleanValue_10=False,
    BooleanValue_11=False,
    BooleanValue_12=False,
    BooleanValue_13=False,
    BooleanValue_14=False,
    BooleanValue_15=False,
    BooleanValue_16=False,
    BooleanValue_17=False,
    BooleanValue_18=False,
    BooleanValue_19=False,
    BooleanValue_2=False,
    BooleanValue_20=False,
    BooleanValue_3=False,
    BooleanValue_4=False,
    BooleanValue_5=False,
    BooleanValue_6=False,
    BooleanValue_7=False,
    BooleanValue_8=False,
    BooleanValue_9=False,
    Color_0=RGBA(0, 0, 0, 0),
    Color_1=RGBA(0, 0, 0, 0),
    Color_10=RGBA(0, 0, 0, 0),
    Color_11=RGBA(0, 0, 0, 0),
    Color_12=RGBA(0, 0, 0, 0),
    Color_13=RGBA(0, 0, 0, 0),
    Color_14=RGBA(0, 0, 0, 0),
    Color_15=RGBA(0, 0, 0, 0),
    Color_16=RGBA(0, 0, 0, 0)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)  # -> SensorPts, SensorData
average = Average(Input=flatten(grid_viewer.SensorData))
scene_object_6 = SceneObject(
    Geometry=brep_6,
    BooleanValue_0=False,
    BooleanValue_1=False,
    Color_0=RGBA(0, 0, 0, 0),
    Color_1=RGBA(0, 0, 0, 0),
    Hidden_0=False,
    Hidden_1=False,
    IntegerValue_0=-2147483648,
    IntegerValue_1=-2147483648,
    IntervalMax_0=-1.797693135e+308,
    IntervalMax_1=-1.797693135e+308,
    IntervalMin_0=-1.797693135e+308,
    IntervalMin_1=-1.797693135e+308,
    Name_0="Geometry",
    Name_1="Material",
    NumberValue_0=-1.797693135e+308,
    NumberValue_1=-1.797693135e+308,
    OutputHidden_0=False,
    OutputName_0="Scene Object",
    TextValuePersistent_1="OutsideFacade_30",
    TextValueVolatile_1="OutsideFacade_30")
annual_daylight_2 = AnnualDaylight(
    Name="Temp",
    Grids=flatten(daylighting_grid_2),
    Objects=[scene_object_2, scene_object_3, scene_object_6, scene_object_4, scene_object_5],
    RhinoScene=False,
    Run=boolean_toggle,
    BooleanValue_0=False,
    BooleanValue_1=False,
    BooleanValue_10=False,
    BooleanValue_11=False,
    BooleanValue_12=False,
    BooleanValue_13=False,
    BooleanValue_14=False,
    BooleanValue_15=False,
    BooleanValue_16=True,
    BooleanValue_17=False,
    BooleanValue_2=False,
    BooleanValue_3=False,
    BooleanValue_4=False,
    BooleanValue_5=False,
    BooleanValue_6=False,
    BooleanValue_7=False,
    BooleanValue_8=False,
    BooleanValue_9=False,
    Color_0=RGBA(0, 0, 0, 0),
    Color_1=RGBA(0, 0, 0, 0),
    Color_10=RGBA(0, 0, 0, 0),
    Color_11=RGBA(0, 0, 0, 0),
    Color_12=RGBA(0, 0, 0, 0),
    Color_13=RGBA(0, 0, 0, 0),
    Color_14=RGBA(0, 0, 0, 0),
    Color_15=RGBA(0, 0, 0, 0),
    Color_16=RGBA(0, 0, 0, 0),
    Color_17=RGBA(0, 0, 0, 0),
    Color_2=RGBA(0, 0, 0, 0),
    Color_3=RGBA(0, 0, 0, 0)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)  # -> Out, SDA, ASE, LEEDv4, LightingEnergy, OpenPercentage, Windows, Grids, Zones
grid_viewer_2 = GridViewer(
    Grid=annual_daylight_2.Grids,
    Month=Slider(12, range=0..100),
    Day=Slider(21, range=0..100),
    Hour=12,
    BooleanValue_0=False,
    BooleanValue_1=False,
    BooleanValue_10=False,
    BooleanValue_11=False,
    BooleanValue_12=False,
    BooleanValue_13=False,
    BooleanValue_14=False,
    BooleanValue_15=False,
    BooleanValue_16=False,
    BooleanValue_17=False,
    BooleanValue_18=False,
    BooleanValue_19=False,
    BooleanValue_2=False,
    BooleanValue_20=False,
    BooleanValue_3=False,
    BooleanValue_4=False,
    BooleanValue_5=False,
    BooleanValue_6=False,
    BooleanValue_7=False,
    BooleanValue_8=False,
    BooleanValue_9=False,
    Color_0=RGBA(0, 0, 0, 0),
    Color_1=RGBA(0, 0, 0, 0),
    Color_10=RGBA(0, 0, 0, 0),
    Color_11=RGBA(0, 0, 0, 0),
    Color_12=RGBA(0, 0, 0, 0),
    Color_13=RGBA(0, 0, 0, 0),
    Color_14=RGBA(0, 0, 0, 0),
    Color_15=RGBA(0, 0, 0, 0),
    Color_16=RGBA(0, 0, 0, 0)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)  # -> SensorPts, SensorData
average_2 = Average(Input=flatten(grid_viewer_2.SensorData))
daylighting_grid_3 = DaylightingGrid(
    Geometry=move.Geometry,
    Spacing=2.5,
    BooleanValue_0=False,
    BooleanValue_1=False,
    BooleanValue_10=False,
    BooleanValue_11=False,
    BooleanValue_12=False,
    BooleanValue_13=False,
    BooleanValue_14=False,
    BooleanValue_15=False,
    BooleanValue_16=False,
    BooleanValue_17=False,
    BooleanValue_18=False,
    BooleanValue_19=False,
    BooleanValue_2=False,
    BooleanValue_20=False,
    BooleanValue_21=False,
    BooleanValue_22=False,
    BooleanValue_3=False,
    BooleanValue_4=False,
    BooleanValue_5=False,
    BooleanValue_6=False,
    BooleanValue_7=False,
    BooleanValue_8=False,
    BooleanValue_9=False,
    Color_0=RGBA(0, 0, 0, 0),
    Color_1=RGBA(0, 0, 0, 0),
    Color_10=RGBA(0, 0, 0, 0),
    Color_11=RGBA(0, 0, 0, 0),
    Color_12=RGBA(0, 0, 0, 0),
    Color_13=RGBA(0, 0, 0, 0),
    Color_14=RGBA(0, 0, 0, 0)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)
panel_2 = Panel(graph_mapper)
panel_3 = Panel("""0
0
0
0
0
0
0
0
0
0
0""")
boolean_toggle_2 = BooleanToggle(True)

# ---- group: entrance_punish
series = Series(Start=0, Step=1, Count=3)
surface_2 = Surface(additiveformmassingcomponent.FloorPlanSurface)
tree_branch = TreeBranch(Tree=surface_2, Path=series, MaintainPaths=True)
brep_8 = Brep(tree_branch)
list_item_3 = ListItem(List=brep_8, Index=Slider(0, range=0..10), Wrap=True)
panel_4 = Panel(tree_branch)
surface_3 = Surface(flatten(tree_branch))
area = Area(Geometry=surface_3)  # -> Area, Centroid
deconstruct = Deconstruct(Point=area.Centroid)  # -> XComponent, YComponent, ZComponent
negative = Negative(Value=deconstruct.ZComponent)
unit_z_2 = UnitZ(Factor=negative)
move_2 = Move(Geometry=surface_3, Motion=unit_z_2)  # -> Geometry, Transform
solid_union = SolidUnion(Breps=move_2.Geometry)
area_2 = Area(Geometry=solid_union)  # -> Area, Centroid
mass_addition = MassAddition(Input=area_2.Area)  # -> Result, PartialResults
curve = Curve(<curve referenced from the Rhino model>)
area_3 = Area(Geometry=curve)  # -> Area, Centroid
expression_3 = Expression(Variable_x=mass_addition.Result, Variable_y=area_3.Area, Expression="x/y")

# ----
division = Division(A=list_item_2, B=area_3.Area)
density = Number(division)

# ---- group: density_punish
curve_2 = Curve(<curve referenced from the Rhino model>)
boundary_surfaces = BoundarySurfaces(Edges=curve_2)
expression_4 = Expression(Variable_x=expression_3, Expression="1-Abs((x-0.4)/0.4)")
solid_difference = SolidDifference(BrepsA=boundary_surfaces, BrepsB=solid_union)
area_4 = Area(Geometry=solid_difference)  # -> Area, Centroid
graph_mapper_2 = GraphMapper(expression_4, x0=0, x1=1, y0=0, y1=1, Cx=0.7822035551, Cy=0.2873837948, container_name="Conic")
panel_5 = Panel(graph_mapper_2)
mass_addition_2 = MassAddition(Input=area_4.Area)  # -> Result, PartialResults
area_5 = Area(Geometry=solid_union)  # -> Area, Centroid
area_6 = Area(Geometry=boundary_surfaces)  # -> Area, Centroid

# ---- group: entrance_punish (continued)
solid_intersection = SolidIntersection(BrepsA=solid_union, BrepsB=boundary_surfaces)
solid_union_2 = SolidUnion(Breps=[solid_union, boundary_surfaces])
solid_union_3 = SolidUnion(Breps=solid_intersection)
area_7 = Area(Geometry=solid_union_3)  # -> Area, Centroid
subtraction = Subtraction(A=area_7.Area, B=mass_addition_2.Result)
expression_5 = Expression(Variable_x=subtraction, Variable_y=area_6.Area, Expression="x/y")
panel_6 = Panel(expression_5)

# ----
mass_addition_3 = MassAddition(Input=area_5.Area)  # -> Result, PartialResults
graph_mapper_3 = GraphMapper(
    expression_5,
    x0=0.6,
    x1=1,
    y0=0,
    y1=1,
    container_name="Bezier",
    cpx=[0, 0.3119741678, 0, 1],
    cpy=[1, 1, 0.2649623156, 0.2598500848])

# ---- group: filter
larger_than = LargerThan(FirstNumber=graph_mapper_3, SecondNumber=Slider(0.6, range=0..1))  # -> LargerThan, OrEqualTo
pick_n_choose = PickNChoose(Pattern=larger_than.LargerThan, Stream0=Slider(1, range=0..1), Stream1=graph_mapper_3)

# ----
expression_6 = Expression(
    Variable_x=expression,
    Variable_y=pick_n_choose,
    z=graph_mapper,
    u=graph_mapper_2,
    v=average_2,
    w=average,
    Expression="x*y*z*u*v*w")
number = Number([list_item_2, expression_3, density, list_length, graph_mapper, graph_mapper_2, mass_addition_3.Result, pick_n_choose, average_2, average, expression_6])
runningrecordcomponent = RunningRecordComponent(
    XMLFilePath="p:\绿建竞赛\xmlRecord_test.Xml",
    ScreenShotFolderDir="P:\绿建竞赛\printscreen\",
    InputVariables=panel_3,
    FitnessValue=expression_6,
    OtherFitnessValueList=number,
    FitnessNameList=panel,
    IsMaximize=True,
    RecordAllData=False)  # -> Path, Test
panel_7 = Panel(runningrecordcomponent.Test)
panel_8 = Panel(pick_n_choose)
